# Grasshopper definition sunlight.ghx (Grasshopper 1.0.7)

start_m = GetInteger(AtLeast=1, AtMost=1, Maximum=2147483647, Minimum=-2147483648, TreeAccess=False)
start_d = GetInteger(AtLeast=1, AtMost=1, Maximum=2147483647, Minimum=-2147483648, TreeAccess=False)
start_h = GetInteger(AtLeast=1, AtMost=1, Maximum=2147483647, Minimum=-2147483648, TreeAccess=False)
end_m = GetInteger(AtLeast=1, AtMost=1, Maximum=2147483647, Minimum=-2147483648, TreeAccess=False)
end_d = GetInteger(AtLeast=1, AtMost=1, Maximum=2147483647, Minimum=-2147483648, TreeAccess=False)
end_h = GetInteger(AtLeast=1, AtMost=1, Maximum=2147483647, Minimum=-2147483648, TreeAccess=False)
epw = GetString(AtLeast=1, AtMost=1, TreeAccess=False)
geo = GetGeometry(AtLeast=1, AtMost=1, DeleteInput=False, Filter=1074004029, TreeAccess=False)
context = GetGeometry(AtLeast=1, AtMost=1, DeleteInput=False, Filter=1074004029, TreeAccess=False)
importepw = LBImportEPW(epw_file=epw)  # -> location, dry_bulb_temperature, dew_point_temperature, relative_humidity, wind_speed, wind_direction, direct_normal_rad, diffuse_horizontal_rad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; plug-in component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
analysisperiod = LBAnalysisPeriod(start_month=start_m, start_day=start_d, start_hour=start_h, end_month=end_m, end_day=end_d, end_hour=end_h)  # -> period, hoys, dates; plug-in component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
sunion = SolidUnion(Breps=geo)
sunpath = LBSunPath(location=importepw.location, hoys=analysisperiod.hoys, scale=1)  # -> report, vectors, altitudes, azimuths, hoys, sun_pts, analemma, daily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; plug-in component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
directsunhours = LBDirectSunHours(
    vectors=flatten(sunpath.vectors),
    geometry=flatten(sunion),
    context=flatten(context),
    grid_size=Slider(10000, range=0..10000),
    offset_dist=Slider(100, range=0..100),
    run=Toggle(True))  # -> report, points, results, mesh, legend, title, int_mtx; plug-in component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

# ---- group: RH_OUT:mesh
mesh = Mesh(directsunhours.mesh)
